# Grasshopper definition Waves.gh (Grasshopper 1.0.7)

X = GetNumber(Slider(2.634, range=0..10), AtLeast=1, AtMost=1, Maximum=1.797693135e+308, Minimum=-1.797693135e+308, TreeAccess=False)
Y = GetNumber(Slider(9.757, range=0..10), AtLeast=1, AtMost=1, Maximum=1.797693135e+308, Minimum=-1.797693135e+308, TreeAccess=False)
recgrid = Rectangular(Plane=PlaneXY(0, 0, 0), SizeX=X, SizeY=Y, ExtentX=Slider(5, range=0..100), ExtentY=Slider(43, range=0..100))  # -> simplify(Cells), Points
tstat = TreeStatistics(Tree=recgrid.Cells)  # -> Paths, Length, Count
item = ListItem(List=tstat.Paths, Index=0, Wrap=True)
branch = TreeBranch(Tree=recgrid.Cells, Path=item, MaintainPaths=True)
cp = ControlPoints(Curve=branch)  # -> Points, Weights, Knots
cull_i = CullIndex(List=cp.Points, Indices=0, Wrap=True)
dispatch = Dispatch(List=cull_i, DispatchPattern=[True, False])  # -> ListA, ListB
pline = PolyLine(Vertices=dispatch.ListA, Closed=False)
pline_2 = PolyLine(Vertices=dispatch.ListB, Closed=False)
merge = Merge(Data1=pline, Data2=pline_2)  # -> simplify(Result)
group = Group(Objects=merge)  # -> flatten(Group)
dispatch_2 = Dispatch(List=group, DispatchPattern=[True, False])  # -> ListA, ListB
ungroup = Ungroup(Group=dispatch_2.ListA)
ungroup_2 = Ungroup(Group=dispatch_2.ListB)
item_2 = ListItem(List=ungroup, Index=0, Wrap=True)
item_3 = ListItem(List=ungroup_2, Index=1, Wrap=True)
merge_2 = Merge(Data1=item_2, Data2=item_3)  # -> flatten(Result)
join = JoinCurves(Curves=merge_2, Preserve=False)
cp_2 = ControlPoints(Curve=join)  # -> Points, Weights, Knots
intcrv = Interpolate(Vertices=cp_2.Points, Degree=3, Periodic=False, KnotStyle=1)  # -> Curve, Length, Domain
steps = GetInteger(Slider(16, range=0..100), AtLeast=1, AtMost=1, Maximum=2147483647, Minimum=-2147483648, TreeAccess=False)
mirror = Mirror(Geometry=intcrv.Curve, Plane=PlaneYZ(0, 0, 0))  # -> Geometry, Transform
merge_3 = Merge(Data1=intcrv.Curve, Data2=mirror.Geometry)
series = Series(Start=0, Step=steps, Count=Slider(66, range=0..100))
group_2 = Group(Objects=merge_3)
rad = Radians(Degrees=series)
bbox = BoundingBox(Content=group_2, Plane=PlaneXY(0, 0, 0))  # -> Box, Box_2
cos = Cosine(Value=rad)
sin = Sine(Value=rad)
area = Area(Geometry=bbox.Box)  # -> Area, Centroid
dom = ConstructDomain(DomainStart=Slider(5.01, range=0..10), DomainEnd=Slider(30, range=0..30))
bnd = Bounds(Numbers=sin)
dom_2 = ConstructDomain(DomainStart=Slider(0.4, range=0..1), DomainEnd=Slider(1.5, range=0..10))
bnd_2 = Bounds(Numbers=cos)
remap = RemapNumbers(Value=cos, Source=bnd_2, Target=dom)  # -> Mapped, Clipped
remap_2 = RemapNumbers(Value=sin, Source=bnd, Target=dom_2)  # -> Mapped, Clipped
scale_nu = ScaleNU(Geometry=group_2, Plane=area.Centroid, ScaleX=remap_2.Mapped, ScaleY=1, ScaleZ=1)  # -> Geometry, Transform
bbox_2 = BoundingBox(Content=scale_nu.Geometry, Plane=PlaneXY(0, 0, 0))  # -> Box, Box_2
debox = DeconstructBox(Box=bbox_2.Box)  # -> Plane, X, Y, Z
dedomain = DeconstructDomain(Domain=debox.X)  # -> Start, End
subtraction = Subtraction(A=dedomain.End, B=dedomain.Start)
panel = Panel(subtraction)
consec = ConsecutiveDomains(Numbers=subtraction, Additive=True)
dedomain_2 = DeconstructDomain(Domain=consec)  # -> Start, End
merge_4 = Merge(Data1=0, Data2=flatten(dedomain_2.Start))
X_2 = UnitX(Factor=merge_4)
move = Move(Geometry=scale_nu.Geometry, Motion=X_2)  # -> Geometry, Transform
Z = UnitZ(Factor=remap.Mapped)
panel_2 = Panel(consec)
ungroup_3 = Ungroup(Group=move.Geometry)  # -> simplify(Objects)
graft = GraftTree(Tree=Z, IncludeEmptyLists=True, IncludeNullItems=True)  # -> simplify(Tree)
extr = Extrude(Base=ungroup_3, Direction=graft)
context_bake = ContextBake(Geometry=extr)
flatten = FlattenTree(Tree=extr, Path="{0}")
lng = ListLength(List=flatten)  # -> expr("x-1", Length)
flatten_2 = FlattenTree(Tree=extr, Path="{0}")
range = Range(Domain=Domain(0, 1), Steps=lng)
graft_2 = GraftTree(Tree=flatten_2, IncludeEmptyLists=True, IncludeNullItems=True)
frgb = ColourRGBF(Alpha=1, Red=range, Green=0, Blue=0)
graft_3 = GraftTree(Tree=frgb, IncludeEmptyLists=True, IncludeNullItems=True)  # -> simplify(Tree)
preview = CustomPreview(Geometry=graft_2, Shader=graft_3)
